# Grasshopper definition Boxes-to-lines.gh (Grasshopper 1.0.7)
# plug-ins: Human, Pufferfish, Heteroptera, Kangaroo2 Components, Topologizer, MetaHopper, TT Toolbox, horsterCameraControl

case = Slider(3, range=0..50)
diagonals = Slider(0.65, range=0..1)
actuator = Slider(1, range=1..50)
number_slider = Slider(20, range=0..100)
geo = Geometry([<brep referenced from the Rhino model> x2393])
box = DomainBox(Base=PlaneXY(15.5, 2.5, 0), X=Domain(-1.5, 1.5), Y=Domain(-1.5, 1.5), Z=Domain(0, 2))
rectangle = Rectangle(Plane=box, XSize=Domain(0, 9), YSize=Domain(0, 9), Radius=0)  # -> Rectangle, Length
volume = Volume(Geometry=geo)  # -> Volume, Centroid
arrrec = RectangularArray(Geometry=box, Cell=rectangle.Rectangle, XCount="24", YCount="15")  # -> Geometry, Transform
brepsinc = PointInBreps(Brep=arrrec.Geometry, Point=volume.Centroid, Strict=False)  # -> Inside, Index
cset = CreateSet(List=brepsinc.Index)  # -> Set, Map
sort = SortList(Keys=cset.Set, ValuesA=cset.Set)  # -> Keys, ValuesA
item = ListItem(List=sort.ValuesA, Index=case, Wrap=True)
mindex = MemberIndex(Set=brepsinc.Index, Member=item)  # -> Index, Count
item_2 = ListItem(List=geo, Index=mindex.Index, Wrap=True)
geo_2 = Geometry(item_2)

debrep = DeconstructBrep(Brep=geo_2)  # -> Faces, Edges, Vertices
flatten = FlattenTree(Tree=debrep.Faces, Path="{0}")
flatten_2 = FlattenTree(Tree=debrep.Edges, Path="{0}")
flatten_3 = FlattenTree(Tree=debrep.Vertices, Path="{0}")
eval = EvaluateCurve(Curve=reparameterize(flatten_2), Parameter=0.5)  # -> Point, Tangent, Angle
area = Area(Geometry=flatten)  # -> Area, Centroid
cullpt = CullDuplicates(Points=flatten_3, Tolerance=0.1, CullMode=1)  # -> Points, Indices, Valence
cullpt_2 = CullDuplicates(Points=eval.Point, Tolerance=0.1, CullMode=1)  # -> Points, Indices, Valence
cullpt_3 = CullDuplicates(Points=area.Centroid, Tolerance=0.1, CullMode=1)  # -> Points, Indices, Valence
item_3 = ListItem(List=flatten_2, Index=cullpt_2.Indices, Wrap=True)
item_4 = ListItem(List=flatten, Index=cullpt_3.Indices, Wrap=True)

subtraction = Subtraction(A=1, B=diagonals)
cullduppoints = RemoveDuplicatePoints(InputPoints=<missing>, Tolerance=0.001)  # -> OutputPoints, FirstPointIndexes
cullduplines = RemoveDuplicateLines(InputLines=flatten(<missing>), Tolerance=0.001)  # -> OutputLines, FirstLineIndexes
swatch = ColourSwatch(SwatchColor=RGB(0, 0, 0))
swatch_2 = ColourSwatch(SwatchColor=RGB(255, 255, 255))
multiplication = Multiplication(A="16", B=2)

brep = Brep([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])
swatch_3 = ColourSwatch(SwatchColor=RGB(0, 0, 0))

brep_2 = Brep([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])

# ----
# ELEVATOR
previewmat = CustomPreviewMaterials(Geometry=brep, DiffuseColor=ColourSwatch(SwatchColor=RGB(255, 255, 255)), Transparency=Slider(0, range=0..1))
toggle = GroupToggle(ToggleActive=False, ToggleVisible=True)  # disabled

debrep_2 = DeconstructBrep(Brep=brep_2)  # -> flatten(Faces), Edges, Vertices
srf = Surface(flatten(debrep_2.Faces))
explode = Explode(Curve=srf, Recursive=True)  # -> flatten(Segments), flatten(Vertices)
eval_2 = EvaluateCurve(Curve=reparameterize(explode.Segments), Parameter=0.5)  # -> Point, Tangent, Angle
area_2 = Area(Geometry=srf)  # -> Area, Centroid
cullpt_4 = CullDuplicates(Points=area_2.Centroid, Tolerance=0.1, CullMode=1)  # -> Points, Indices, Valence
cullpt_5 = CullDuplicates(Points=eval_2.Point, Tolerance=0.1, CullMode=1)  # -> Points, Indices, Valence
cullpt_6 = CullDuplicates(Points=explode.Vertices, Tolerance=0.1, CullMode=1)  # -> Points, Indices, Valence
item_5 = ListItem(List=srf, Index=cullpt_4.Indices, Wrap=True)
item_6 = ListItem(List=explode.Segments, Index=cullpt_5.Indices, Wrap=True)

srf_2 = Surface(item_5)
crv = Curve(item_6)
pt = Point(cullpt_6.Points)
pt_2 = Point(pt)
lng = ListLength(List=pt_2)
lng_2 = ListLength(List=pt_2)
dom = ConstructDomain(DomainStart=Slider(0, range=0..1), DomainEnd=Slider(0.65, range=0..1))
lng_3 = ListLength(List=pt_2)
dom_2 = ConstructDomain(DomainStart=Slider(0.1, range=0..1), DomainEnd=Slider(0.3, range=0..1))
number_slider_2 = Slider(0.25, range=0..1)
number_slider_3 = Slider(0.25, range=0..1)
dup = DuplicateData(Data=Slider(6, range=0..10), Number=lng_2, Order=True)  # -> simplify(graft(Data))
random = Random(Range=dom, Number=lng, Seed=2)
dom_3 = ConstructDomain(DomainStart=0, DomainEnd=Slider(1.2, range=0..5))
random_2 = Random(Range=dom_2, Number=lng_3, Seed=2)
rnd_vector = RandomVector(Number=dup, Length=dom_3, seed=1631415, isflat=True)
msphere = MeshSphere(Base=pt_2, Radius=random, UCount=10, VCount=20)
msphere_2 = MeshSphere(Base=pt_2, Radius=random_2, UCount=10, VCount=20)
vlen = VectorLength(Vector=rnd_vector)
line = LineSDL(Start=simplify(graft(pt_2)), Direction=rnd_vector, Length=vlen)
swatch_4 = ColourSwatch(SwatchColor=RGB(230, 0, 19))
swatch_5 = ColourSwatch(SwatchColor=RGB(0, 0, 0))
swatch_6 = ColourSwatch(SwatchColor=RGB(255, 255, 0))
swatch_7 = ColourSwatch(SwatchColor=RGB(255, 255, 255))
swatch_8 = ColourSwatch(SwatchColor=RGB(207, 207, 207))
line_2 = Line(flatten(line))

# ----
# NODES
preview = CustomPreview(Geometry=msphere, Material=ColourSwatch(SwatchColor=RGB(224, 224, 224)))
toggle_2 = GroupToggle(ToggleActive=True, ToggleVisible=False)  # disabled

previewlw = CustomPreviewLineweights(Geometry=line_2, Shader=swatch_8, Thickness=Slider(0.11, range=0..1), Absolute=invert(False))
preview_2 = CustomPreview(Geometry=msphere_2, Material=swatch_8)

crv_2 = Curve(crv)
swatch_9 = ColourSwatch(SwatchColor=RGB(82, 82, 82))

cluster = Cluster()  # -> R, R_2, R_3
cull = CullPattern(List=crv_2, CullPattern=cluster.R)
cull_2 = CullPattern(List=crv_2, CullPattern=cluster.R_2)
cull_3 = CullPattern(List=crv_2, CullPattern=cluster.R_3)
number_slider_4 = Slider(0.1, range=0..1)
number_slider_5 = Slider(0.02, range=0..1)
number_slider_6 = Slider(0.03, range=0..1)
shader = Shader(swatch_9)
swatch_10 = ColourSwatch(SwatchColor=RGB(0, 0, 0))
swatch_11 = ColourSwatch(SwatchColor=RGB(0, 0, 0))
swatch_12 = ColourSwatch(SwatchColor=RGB(0, 0, 0))
swatch_13 = ColourSwatch(SwatchColor=RGB(0, 0, 0))

# ----
# BLACK
# ELEMENTS
toggle_3 = GroupToggle(ToggleActive=False, ToggleVisible=True)  # disabled
previewlw_2 = CustomPreviewLineweights(Geometry=cull, Shader=shader, Thickness=number_slider_4, Absolute=invert(False))
previewlw_3 = CustomPreviewLineweights(Geometry=cull_2, Shader=shader, Thickness=number_slider_4, Absolute=invert(False))
previewlw_4 = CustomPreviewLineweights(Geometry=cull_3, Shader=shader, Thickness=number_slider_4, Absolute=invert(False))
previewlw_5 = CustomPreviewLineweights(Geometry=crv_2, Shader=shader, Thickness=Slider(0.03, range=0..1), Absolute=invert(False))

# ----
# FIELDS
toggle_4 = GroupToggle(ToggleActive=False, ToggleVisible=True)  # disabled

number_slider_7 = Slider(0.07, range=0..1)
swatch_14 = ColourSwatch(SwatchColor=RGB(0, 0, 0))
swatch_15 = ColourSwatch(SwatchColor=RGB(135, 201, 255))
swatch_16 = ColourSwatch(SwatchColor=RGB(232, 232, 232))
swatch_17 = ColourSwatch(SwatchColor=RGB(255, 166, 173))

# ----
# SOME
# DIAGONALS
toggle_5 = GroupToggle(ToggleActive=False, ToggleVisible=True)  # disabled

number_slider_8 = Slider(0.24, range=0..1)
dom_4 = ConstructDomain(DomainStart=Slider(0, range=0..1), DomainEnd=Slider(0.3, range=0..1))
col = Colour(swatch_9)

bbox = BoundingBox(Content=geo_2, Plane=PlaneXY(0, 0, 0), UnionBox=True)  # -> Box, Box_2
volume_2 = Volume(Geometry=arrrec.Geometry)  # -> Volume, Centroid
volume_3 = Volume(Geometry=bbox.Box)  # -> Volume, Centroid
cp = ClosestPoint(Point=volume_3.Centroid, Cloud=volume_2.Centroid)  # -> ClosestPoint, CPIndex, Distance
num = Number("50")

vec = VectorXYZ(
    XComponent=expr("-x", Slider(5, range=1..10)),
    YComponent=expr("-x", Slider(7.5, range=1..10)),
    ZComponent=Slider(4.2, range=1..10))  # -> Vector, Length

move = Move(Geometry=cp.ClosestPoint, Motion=vec.Vector)  # -> Geometry, Transform
setcam = SetCamera(CameraLocation=move.Geometry, TargetLocation=cp.ClosestPoint, LensLength=num, Activate=Toggle(True))

srf_3 = Surface(item_4)
line_3 = Line(item_3)
pt_3 = Point(cullpt.Points)
lng_4 = ListLength(List=pt_3)
lng_5 = ListLength(List=line_3)
msphere_3 = MeshSphere(Base=pt_3, Radius="0.015", UCount=10, VCount=20)
lng_6 = ListLength(List=srf_3)
multiplication_2 = Multiplication(A=lng_6, B=subtraction)
reduce = RandomReduce(List=srf_3, Reduction=multiplication_2, Seed=number_slider)
debrep_3 = DeconstructBrep(Brep=reduce)  # -> simplify(flatten(Faces)), Edges, Vertices
index = ItemIndex(List=srf_3, Item=reduce)
cull_i = CullIndex(List=srf_3, Indices=index, Wrap=True)
explode_2 = Explode(Curve=debrep_3.Faces, Recursive=True)  # -> Segments, Vertices
area_3 = Area(Geometry=cull_i)  # -> Area, Centroid
cull_i_2 = CullIndex(List=explode_2.Vertices, Indices=-1, Wrap=True)  # -> simplify(List)
lng_7 = ListLength(List=debrep_3.Faces)
random_3 = Random(Range=Domain(0, 1), Number=lng_7, Seed=2)
round = Round(Number=random_3)  # -> graft(Nearest), Floor, Ceiling

lng_8 = ListLength(List=reduce)
offset = OffsetCurve(Curve=cull_i, Distance=-0.025, Corners=1)  # -> simplify(Curve)
srf_4 = Surface(offset)
item_7 = ListItem(List=simplify(cull_i_2), Index=simplify(round.Nearest), Wrap=True)  # -> Item, Item1, Item2

ln = Line(StartPoint=item_7.Item, EndPoint=item_7.Item2)  # -> flatten(Line)
jitter = Jitter(List=ln, Jitter=1, Seed=2)  # -> Values, Indices
lng_9 = ListLength(List=jitter.Values)
multiplication_3 = Multiplication(A=lng_9)
split = SplitList(List=jitter.Values, Index=actuator)  # -> ListA, ListB
eval_3 = EvaluateCurve(Curve=reparameterize(split.ListA), Parameter=0.5)  # -> Point, Tangent, Angle
scale = Scale(Geometry=split.ListA, Center=eval_3.Point, Factor=0.2)  # -> Geometry, Transform

division = Division(A=actuator, B=lng_8)
multiplication_4 = Multiplication(A=division, B=100)
round_2 = Round(Number=multiplication_3)  # -> Nearest, Floor, Ceiling
addition = Addition(A=cp.CPIndex, B=1)
multiplication_5 = Multiplication(A=diagonals, B=100)
round_3 = Round(Number=multiplication_4)  # -> Nearest, Floor, Ceiling
concat = Concatenate(FragmentA="Number of Actuator : ", FragmentB=actuator)
concat_2 = Concatenate(FragmentA="Dia to Act proportion : ", FragmentB=round_3.Nearest, FragmentC="%")
concat_3 = Concatenate(FragmentA="case number : ", FragmentB=addition)
concat_4 = Concatenate(FragmentA="Number of nodes : ", FragmentB=lng_4)
concat_5 = Concatenate(FragmentA="Seed : ", FragmentB=number_slider)
concat_6 = Concatenate(FragmentA="Diagonals : ", FragmentB=multiplication_5, FragmentC="%")
concat_7 = Concatenate(FragmentA="Number of Diagonals : ", FragmentB=lng_8)
concat_8 = Concatenate(FragmentA="Number of lines : ", FragmentB=lng_5)
merge = Merge(
    Data1=flatten(concat_3),
    Data2=flatten(concat_8),
    Data3=flatten(concat_7),
    Data4=flatten(concat_6),
    Data5=flatten(concat),
    Data6=flatten(concat_2),
    Data8=flatten(concat_4),
    Data9=flatten(concat_5))  # -> flatten(Result)
lng_10 = ListLength(List=merge)
series = Series(Start="50", Step=multiplication, Count=lng_10)
concat_9 = Concatenate(FragmentA="50", FragmentC=",", FragmentB=series)
texttoscreen = RenderTextToScreen(Text=merge, Location=concat_9, Size="16", Color=RGB(0, 0, 0), m_scWithvp=False)

previewlw_6 = CustomPreviewLineweights(Geometry=split.ListB, Shader=ColourSwatch(SwatchColor=RGB(255, 255, 0)), Thickness="3", Absolute=False)
previewmat_2 = CustomPreviewMaterials(Geometry=msphere_3, DiffuseColor=swatch, Transparency=0)
previewlw_7 = CustomPreviewLineweights(Geometry=split.ListA, Shader=ColourSwatch(SwatchColor=RGB(230, 0, 86)), Thickness="3", Absolute=False)
previewmat_3 = CustomPreviewMaterials(Geometry=srf_4, DiffuseColor=ColourSwatch(SwatchColor=RGB(100, 100, 100)), Transparency=Slider(0.2, range=0..1))
previewlw_8 = CustomPreviewLineweights(Geometry=line_3, Shader=swatch, Thickness="3", Absolute=False)
previewlw_9 = CustomPreviewLineweights(Geometry=scale.Geometry, Shader=ColourSwatch(SwatchColor=RGB(0, 0, 255)), Thickness="7", Absolute=False)

evalsrf = EvaluateSurface(Surface=reparameterize(srf_2), Point="0.5, 0.5")  # -> Point, Normal, UDirection, VDirection, Frame
pl = PlaneNormal(Origin=evalsrf.Point, ZAxis=evalsrf.Normal)
offcrv = OffsetCurve(Curve=srf_2, Plane=pl, Distance=Slider(-0.3, range=-0.4..0.8), BothSides=invert(False), Kinks=0, CapType=1)
area_4 = Area(Geometry=offcrv)  # -> Area, Centroid
sort_2 = SortList(Keys=area_4.Area, ValuesA=offcrv)  # -> simplify(Keys), ValuesA
item_8 = ListItem(List=sort_2.ValuesA, Index=0, Wrap=True)  # -> flatten(Item)

boundary = BoundarySurfaces(Edges=item_8)  # -> flatten(Surfaces)
srf_5 = Surface(boundary)

area_5 = Area(Geometry=srf_5)  # -> Area, Centroid
pdecon = Deconstruct(Point=area_5.Centroid)  # -> XComponent, YComponent, ZComponent
round_4 = Round(Number=pdecon.ZComponent)  # -> Nearest, Floor, Ceiling
equals = Equality(FirstNumber=round_4.Nearest, SecondNumber=0)  # -> Equality, Inequality
cull_4 = CullPattern(List=srf_5, CullPattern=equals.Inequality)
jitter_2 = Jitter(List=cull_4, Jitter=1, Seed=2)  # -> Values, Indices

srf_6 = Surface(jitter_2.Values)
lng_11 = ListLength(List=srf_6)
multiplication_6 = Multiplication(A=lng_11, B=Slider(0.1, range=0..1))
split_2 = SplitList(List=srf_6, Index=multiplication_6)  # -> ListA, ListB
split_3 = SplitList(List=split_2.ListB, Index=multiplication_6)  # -> ListA, ListB
split_4 = SplitList(List=split_3.ListB, Index=multiplication_6)  # -> ListA, ListB
geo_3 = Geometry(split_3.ListA)
geo_4 = Geometry(split_2.ListA)
geo_5 = Geometry(split_4.ListA)
geo_6 = Geometry(split_4.ListB)
explode_3 = Explode(Curve=geo_4, Recursive=True)  # -> Segments, Vertices
explode_4 = Explode(Curve=geo_3, Recursive=True)  # -> Segments, Vertices
explode_5 = Explode(Curve=geo_5, Recursive=True)  # -> Segments, Vertices
item_9 = ListItem(List=explode_3.Vertices, Index=0, Wrap=True)  # -> Item, Item1, Item2, Item3
item_10 = ListItem(List=explode_5.Vertices, Index=0, Wrap=True)  # -> Item, Item1, Item2, Item3
item_11 = ListItem(List=explode_4.Vertices, Index=0, Wrap=True)  # -> Item, Item1, Item2, Item3
ln_2 = Line(StartPoint=item_9.Item1, EndPoint=item_9.Item3)
ln_3 = Line(StartPoint=item_11.Item, EndPoint=item_11.Item2)
ln_4 = Line(StartPoint=item_10.Item1, EndPoint=item_10.Item3)
ln_5 = Line(StartPoint=item_10.Item, EndPoint=item_10.Item2)

toggle_6 = GroupToggle(ToggleActive=False, ToggleVisible=True)  # disabled
previewlw_10 = CustomPreviewLineweights(Geometry=ln_2, Shader=swatch_9, Thickness=number_slider_7, Absolute=invert(False))
previewlw_11 = CustomPreviewLineweights(Geometry=ln_3, Shader=swatch_9, Thickness=number_slider_7, Absolute=invert(False))
previewlw_12 = CustomPreviewLineweights(Geometry=ln_5, Shader=swatch_9, Thickness=number_slider_7, Absolute=invert(False))

previewmat_4 = CustomPreviewMaterials(Geometry=geo_5, DiffuseColor=swatch_16, Transparency=Slider(0.66, range=0..1))
previewmat_5 = CustomPreviewMaterials(Geometry=[geo_4, geo_3], DiffuseColor=swatch_16, Transparency=Slider(0.88, range=0..1))

crv_3 = Curve(flatten([ln_2, ln_3, ln_5, ln_4]))

crv_4 = Curve(flatten([crv_2, ln_4, ln_5, ln_3, ln_2]))
eval_4 = EvaluateCurve(Curve=reparameterize(crv_4), Parameter=0.5)  # -> Point, Tangent, Angle
pdecon_2 = Deconstruct(Point=eval_4.Point)  # -> XComponent, YComponent, ZComponent
crv_5 = Curve(crv_3)
srf_7 = Surface(srf_5)
line_4 = Line(crv_3)
smaller = SmallerThan(FirstNumber=pdecon_2.ZComponent, SecondNumber=0.1)  # -> SmallerThan, OrEqualTo
lng_12 = ListLength(List=crv_3)
eval_5 = EvaluateCurve(Curve=reparameterize(crv_5), Parameter=0.5)  # -> Point, Tangent, Angle
len = Length(Curve=crv_5)

# ---- group: actuators
line_5 = Line(flatten([ln_2, ln_3, ln_5, ln_4]))
lng_13 = ListLength(List=line_5)
multiplication_7 = Multiplication(A=lng_13, B=Slider(0.37, range=0..1))
reduce_2 = RandomReduce(List=line_5, Reduction=multiplication_7, Seed=1)
len_2 = Length(Curve=reduce_2)
subtraction_2 = Subtraction(A=len_2, B=1.5)
division_2 = Division(A=subtraction_2, B=-2)
ext = ExtendCurve(Curve=reduce_2, Type=0, Start=division_2, End=division_2)
swatch_18 = ColourSwatch(SwatchColor=RGB(255, 255, 255))
swatch_19 = ColourSwatch(SwatchColor=RGB(250, 250, 5))
previewlw_13 = CustomPreviewLineweights(
    Geometry=ext,
    Shader=ColourSwatch(SwatchColor=RGB(166, 0, 14)),
    Thickness=Slider(0.26, range=0..1),
    Absolute=invert(False))

# ----
area_6 = Area(Geometry=srf_7)  # -> Area, Centroid
lng_14 = ListLength(List=line_4)  # -> expr("x/2", Length)
jitter_3 = Jitter(List=line_4, Jitter=1, Seed=2)  # -> Values, Indices
multiplication_8 = Multiplication(A=lng_12, B=0.6)
cull_5 = CullPattern(List=crv_4, CullPattern=invert(smaller.SmallerThan))  # -> flatten(List)
reduce_3 = RandomReduce(List=crv_3, Reduction=multiplication_8, Seed=1)

# ----
# SMOOTH PIPE MESH
toggle_7 = GroupToggle(ToggleActive=True, ToggleVisible=False)  # disabled
crv_6 = Curve(cull_5)

split_5 = SplitList(List=jitter_3.Values, Index=lng_14)  # -> ListA, ListB
lng_15 = ListLength(List=split_5.ListB)  # -> expr("x/2", Length)
yz = YZPlane(Origin=eval_5.Point)
split_6 = SplitList(List=reduce_3, Index=Slider(50, range=0..100))  # -> ListA, ListB
lng_16 = ListLength(List=split_5.ListA)
split_7 = SplitList(List=split_5.ListB, Index=lng_15)  # -> ListA, ListB
lng_17 = ListLength(List=split_5.ListA)  # -> expr("x/1.2", Length)
random_4 = Random(Range=dom_4, Number=lng_16, Seed=2)
split_8 = SplitList(List=split_5.ListA, Index=lng_17)  # -> ListA, ListB
explode_6 = Explode(Curve=crv_6, Recursive=True)  # -> flatten(Segments), Vertices

# ----
# COLORED
# ELEMENTS
toggle_8 = GroupToggle(ToggleActive=False, ToggleVisible=True)  # disabled
previewlw_14 = CustomPreviewLineweights(
    Geometry=split_8.ListB,
    Shader=ColourSwatch(SwatchColor=RGB(255, 255, 0)),
    Thickness=Slider(0.12, range=0..1),
    Absolute=invert(False))
previewlw_15 = CustomPreviewLineweights(
    Geometry=split_8.ListA,
    Shader=ColourSwatch(SwatchColor=RGB(84, 84, 84)),
    Thickness=Slider(0.1, range=0..0.1),
    Absolute=invert(False))
previewlw_16 = CustomPreviewLineweights(Geometry=split_7.ListA, Shader=ColourSwatch(SwatchColor=RGB(255, 0, 21)), Thickness=random_4, Absolute=invert(False))
previewlw_17 = CustomPreviewLineweights(Geometry=split_7.ListB, Shader=ColourSwatch(SwatchColor=RGB(0, 86, 214)), Thickness=random_4, Absolute=invert(False))

previewlw_18 = CustomPreviewLineweights(
    Geometry=split_6.ListA,
    Shader=ColourSwatch(SwatchColor=RGB(201, 0, 17)),
    Thickness=number_slider_8,
    Absolute=invert(False))
previewlw_19 = CustomPreviewLineweights(
    Geometry=split_6.ListB,
    Shader=ColourSwatch(SwatchColor=RGB(0, 86, 214)),
    Thickness=number_slider_8,
    Absolute=invert(False))

yz_2 = YZPlane(Origin=area_6.Centroid)

# ----
# TEXT
toggle_9 = GroupToggle(ToggleActive=False, ToggleVisible=True)  # disabled
tag = TextTag3D(Location=yz_2, Text=area_6.Area, Size=Slider(0.3, range=0..0.5), Colour=col, Justification=5)
tag_2 = TextTag3D(Location=yz, Text=len, Size=Slider(0.3, range=0..0.5), Colour=ColourSwatch(SwatchColor=RGB(102, 0, 8)), Justification=7)

topo = Topologizer(LinesInput=explode_6.Segments, Tolerance=0.01)  # -> L, P, S, E, N, I, O, G
mp = MultiPipe(
    Curves=topo.L,
    NodeSize=Slider(0.1, range=0.1..3),
    EndOffset=Slider(0.5, range=0..17),
    StrutSize=Slider(0.8, range=0.1..3),
    Segment=Slider(1, range=0.5..10),
    KinkAngle=0.6,
    CubeFit=0)
preview_3 = CustomPreview(
    Geometry=mp,
    Material={diffuse=RGB(230, 230, 230), emission=RGB(0, 0, 0), shine=0, specular=RGB(255, 255, 255), transparency=0})

# ==== cluster Cluster
toggle = BooleanToggle(True)
toggle_2 = BooleanToggle(False)
merge = Merge(Data1=toggle, Data2=toggle_2, Data3=toggle_2)
merge_2 = Merge(Data1=toggle_2, Data2=toggle, Data3=toggle_2)
merge_3 = Merge(Data1=toggle_2, Data2=toggle_2, Data3=toggle)
R = ClusterOutput(merge)
R_2 = ClusterOutput(merge_2)
R_3 = ClusterOutput(merge_3)
panel = Panel(merge)
